# Grasshopper definition 2020_10_28.Tunnel.gh (Grasshopper 1.0.7)
# plug-ins: Human UI, Bifocals

create_true_only_button = CreateTrueOnlyButton(ButtonName="confirm changes", ButtonStyle=0)
create_button = CreateButton(ButtonName="Reset", ButtonStyle=0)
create_stack = CreateStack(UIElements=[create_button, create_true_only_button], Horizontal=True)
value_listener = ValueListener(Elements=create_button, SomeProperty=True)  # -> Values, Indices
value_listener_2 = ValueListener(Elements=create_true_only_button, SomeProperty=True)  # -> Values, Indices

# ---- group: INPUT HUMAN UI
no_of_spacing_between_bolts_no_of_bolts = Slider(12, range=10..25)  # "No. of spacing between bolts (No.of bolts +1)"
spacing_of_bolts_along_the_road = Slider(2.7, range=2..5)
price_of_concrete_euro_m3 = Slider(150, range=50..150)
length_of_bolts = Slider(2.2, range=2..5)
price_of_bolts = Slider(50, range=50..150)
concrete_thickness = Slider(0.23, range=0.2..0.5)
shoulder_lane_width_3_piennar = Slider(1.5, range=0..2)
width_of_lane_3_ajorata = Slider(0, range=0..4)
shoulder_lane_width_1_piennar = Slider(1.5, range=0..2)
width_of_lane_2_ajorata = Slider(3.5, range=0..4)
shoulder_lane_width_2_piennar = Slider(1.5, range=0..2)
offset_from_rock_face = Slider(0.85, range=0.85..3)
width_of_lane_1_ajorata = Slider(3.5, range=0..4)
create_slider = CreateSlider(
    Slider=no_of_spacing_between_bolts_no_of_bolts,
    ShowBounds=False,
    ShowTicks=False,
    ShowTooltip=False,
    ShowValLabel=True,
    showLabel=True)
create_slider_2 = CreateSlider(Slider=concrete_thickness, ShowBounds=False, ShowTicks=False, ShowTooltip=False, ShowValLabel=True, showLabel=True)
create_slider_3 = CreateSlider(
    Slider=price_of_concrete_euro_m3,
    ShowBounds=False,
    ShowTicks=False,
    ShowTooltip=False,
    ShowValLabel=True,
    showLabel=True)
create_slider_4 = CreateSlider(
    Slider=spacing_of_bolts_along_the_road,
    ShowBounds=False,
    ShowTicks=False,
    ShowTooltip=False,
    ShowValLabel=True,
    showLabel=True)
create_slider_5 = CreateSlider(Slider=length_of_bolts, ShowBounds=False, ShowTicks=False, ShowTooltip=False, ShowValLabel=True, showLabel=True)
create_slider_6 = CreateSlider(Slider=price_of_bolts, ShowBounds=False, ShowTicks=False, ShowTooltip=False, ShowValLabel=True, showLabel=True)
create_slider_7 = CreateSlider(
    Slider=shoulder_lane_width_1_piennar,
    ShowBounds=False,
    ShowTicks=False,
    ShowTooltip=False,
    ShowValLabel=True,
    showLabel=True)
create_slider_8 = CreateSlider(Slider=width_of_lane_2_ajorata, ShowBounds=False, ShowTicks=False, ShowTooltip=False, ShowValLabel=True, showLabel=True)
create_slider_9 = CreateSlider(
    Slider=shoulder_lane_width_3_piennar,
    ShowBounds=False,
    ShowTicks=False,
    ShowTooltip=False,
    ShowValLabel=True,
    showLabel=True)
create_slider_10 = CreateSlider(
    Slider=shoulder_lane_width_2_piennar,
    ShowBounds=False,
    ShowTicks=False,
    ShowTooltip=False,
    ShowValLabel=True,
    showLabel=True)
create_slider_11 = CreateSlider(Slider=width_of_lane_3_ajorata, ShowBounds=False, ShowTicks=False, ShowTooltip=False, ShowValLabel=True, showLabel=True)
create_slider_12 = CreateSlider(Slider=width_of_lane_1_ajorata, ShowBounds=False, ShowTicks=False, ShowTooltip=False, ShowValLabel=True, showLabel=True)
create_slider_13 = CreateSlider(Slider=offset_from_rock_face, ShowBounds=False, ShowTicks=False, ShowTooltip=False, ShowValLabel=True, showLabel=True)
value_listener_3 = ValueListener(Elements=create_slider_3, Trigger=value_listener_2.Values, SomeProperty=False)  # -> Values, Indices
value_listener_4 = ValueListener(Elements=create_slider_6, Trigger=value_listener_2.Values, SomeProperty=False)  # -> Values, Indices
value_listener_5 = ValueListener(Elements=create_slider_9, Trigger=value_listener_2.Values, SomeProperty=False)  # -> Values, Indices
value_listener_6 = ValueListener(Elements=create_slider_2, Trigger=value_listener_2.Values, SomeProperty=False)  # -> Values, Indices
value_listener_7 = ValueListener(Elements=create_slider_7, Trigger=value_listener_2.Values, SomeProperty=False)  # -> Values, Indices
value_listener_8 = ValueListener(Elements=create_slider_11, Trigger=value_listener_2.Values, SomeProperty=False)  # -> Values, Indices
value_listener_9 = ValueListener(Elements=create_slider_8, Trigger=value_listener_2.Values, SomeProperty=False)  # -> Values, Indices
value_listener_10 = ValueListener(Elements=create_slider_12, Trigger=value_listener_2.Values, SomeProperty=False)  # -> Values, Indices
value_listener_11 = ValueListener(Elements=create_slider, Trigger=value_listener_2.Values, SomeProperty=False)  # -> Values, Indices
value_listener_12 = ValueListener(Elements=create_slider_13, Trigger=value_listener_2.Values, SomeProperty=False)  # -> Values, Indices
value_listener_13 = ValueListener(Elements=create_slider_10, Trigger=value_listener_2.Values, SomeProperty=False)  # -> Values, Indices
value_listener_14 = ValueListener(Elements=create_slider_5, Trigger=value_listener_2.Values, SomeProperty=False)  # -> Values, Indices
value_listener_15 = ValueListener(Elements=create_slider_4, Trigger=value_listener_2.Values, SomeProperty=False)  # -> Values, Indices

# ---- group: Introduction for variables
attach_tooltip_to_element = AttachTooltipToElement(
    ElementsToAttachTo=[create_slider_12, create_slider_8, create_slider_11],
    TooltipContent="To decide the width of lane for vehicular movement",
    ShowDelay=500,
    Duration=9000)
attach_tooltip_to_element_2 = AttachTooltipToElement(
    ElementsToAttachTo=[create_slider_7, create_slider_10, create_slider_9],
    TooltipContent="To change the width of the shoulder lanes",
    ShowDelay=500,
    Duration=9000)
attach_tooltip_to_element_3 = AttachTooltipToElement(
    ElementsToAttachTo=create_slider_13,
    TooltipContent="To decide the offset of concrete from internal rock face",
    ShowDelay=500,
    Duration=9000)

# ----
merge = Merge(
    Data1=create_slider_13,
    Data3=create_slider_7,
    Data5=create_slider_10,
    Data6=create_slider_12,
    Data7=create_slider_8,
    Data8=create_slider_11,
    Data9=create_slider_9,
    Data11=create_slider_2,
    Data12=create_slider,
    Data13=create_slider_5,
    Data14=create_slider_4,
    Data15=create_slider_6,
    Data16=create_slider_3)
reset_recorders = Reset_recorders(clean=value_listener.Values)  # inputs clean: Boolean
# ---------- reset_recorders: C# usings ----------
using System.IO;
using System.Linq;
using System.Data;
using System.Drawing;
using System.Reflection;
using System.Windows.Forms;
using System.Xml;
using System.Xml.Linq;
using System.Runtime.InteropServices;

using Rhino.DocObjects;
using Rhino.Collections;
using GH_IO;
using GH_IO.Serialization;
# ---------- reset_recorders: C# ----------
    if(clean)
    {
      //iterate through all the objects of the grashopper document;
      foreach (object obj in GrasshopperDocument.Objects)
      {
        ///chek only for the GH_DataRecorder components
        if (obj is Grasshopper.Kernel.Special.GH_DataRecorder)
        {
          ///cast the obj into GH_DataRecorder wrapper class to be able to access its methods
          Grasshopper.Kernel.Special.GH_DataRecorder dataDestroy = (Grasshopper.Kernel.Special.GH_DataRecorder) obj;

          /// clean the data and reset the recorder component
          dataDestroy.DestroyRecordedData();
          dataDestroy.ExpireSolution(true);

        }
      }
    }
# ---------- end reset_recorders ----------
value_listener_16 = ValueListener(Elements=merge, NameFilterS=value_listener_2.Values, Trigger=value_listener_2.Values, SomeProperty=False)  # -> Values, Indices
create_expander = CreateExpander(UIElements=merge, Header="Variable Parameters( All dimensions are in metre)", Open=True)
adjust_element_positioning = AdjustElementPositioning(
    ElementsToAdjust=create_expander,
    AbsolutePositioning=False,
    Width=Slider(426, range=0..1000),
    Height=Slider(604, range=0..1000),
    HorizontalAlignment=0,
    VerticalAlignment=2)
get_screen_dimensions = GetScreenDimensions()  # -> Width, Height
launch_window = LaunchWindow(
    Show=Toggle(False),
    Name="Tunnel Design phase ",
    Width=expr("0.5*X", get_screen_dimensions.Width),
    Height=expr("0.8*X", get_screen_dimensions.Height),
    ChildStatus=0,
    EnableHorizScroll=False)
panel = Panel("""0
1
0
1
0
0
1""")
panel_2 = Panel("""0
1
1
0
2
2
2""")
addition = Addition(
    A=value_listener_12.Values,
    B=value_listener_7.Values,
    C=value_listener_13.Values,
    D=value_listener_10.Values,
    E=value_listener_9.Values,
    F=value_listener_8.Values,
    G=value_listener_5.Values,
    H=value_listener_12.Values)
panel_3 = Panel(addition)
panel_4 = Panel("C:\Users\gkd965\OneDrive - AFRY\Desktop\Rhino_grasshoper\logo.png")
create_image = CreateImage(ImageSource=panel_4, ImageWidth=300)
adjust_element_positioning_2 = AdjustElementPositioning(
    ElementsToAdjust=create_image,
    AbsolutePositioning=False,
    Width=Slider(444, range=0..1000),
    Height=Slider(125, range=0..1000),
    HorizontalAlignment=2,
    VerticalAlignment=0)
construct_point = ConstructPoint(XCoordinate=expr("X/2", addition), YCoordinate=0, ZCoordinate=0)
construct_point_2 = ConstructPoint(XCoordinate=0, YCoordinate=0, ZCoordinate=0)
construct_point_3 = ConstructPoint(XCoordinate=addition, YCoordinate=0, ZCoordinate=0)
unit_x = UnitX(Factor=1)
unit_z = UnitZ(Factor=addition)
unit_z_2 = UnitZ(Factor=addition)
move = Move(Geometry=[construct_point_2, construct_point_3], Motion=expr("x/2.26", unit_z_2))  # -> Geometry, Transform
move_2 = Move(Geometry=construct_point, Motion=expr("x/1.6", unit_z))  # -> Geometry, Transform
panel_5 = Panel("""Design option 1
Design option 2
Design option 3""")
list_item = ListItem(List=move.Geometry, Index=Slider(1, range=0..1), Wrap=True)
list_item_2 = ListItem(List=move.Geometry, Index=0, Wrap=True)
negative = Negative(Value=value_listener_14.Values)
dummy_values = Panel("""1000
2000
3000""")
create_chart = CreateChart(
    Data=dummy_values,
    Names=panel_5,
    Title="Cost comparision for all the design options",
    SubTitle="Cost in EURO",
    ChartType=2)

# ---- group: ROCK PROFILE
arc_3pt = Arc3Pt(PointA=list_item_2, PointB=move_2.Geometry, PointC=list_item)  # -> Arc, Plane, Radius
line = Line(StartPoint=construct_point_2, EndPoint=list_item_2)
line_2 = Line(StartPoint=construct_point_2, EndPoint=construct_point_3)
line_3 = Line(StartPoint=list_item, EndPoint=construct_point_3)
join_curves = JoinCurves(Curves=[arc_3pt.Arc, line_3, line], Preserve=False)
fillet = Fillet(Curve=join_curves, Radius=Slider(1.5, range=0..10))
join_curves_2 = JoinCurves(Curves=flatten([line_2, fillet]), Preserve=False)
unit_y = UnitY(Factor=Slider(10, range=0..10))
extrude = Extrude(Base=fillet, Direction=unit_y)
create_material = CreateMaterial(Diffuse=RGB(34, 29, 0), Specular=RGB(255, 255, 255), Emission=RGB(0, 4, 0), Transparency=0, Shine=1)
custom_preview = CustomPreview(Geometry=extrude, Material=create_material)

# ----
area = Area(Geometry=join_curves_2)  # -> Area, Centroid
area_2 = Area(Geometry=join_curves_2)  # -> Area, Centroid
ghpython_script = GhPythonScript(Curve=fillet, Direction=area.Centroid, Distance=value_listener_12.Values)  # -> out, a
# ---------- ghpython_script: Python ----------
__author__ = "gkd965"
__version__ = "2020.05.18"

import rhinoscriptsyntax as rs
a =rs.OffsetCurve(Curve,Direction,Distance)
# ---------- end ghpython_script ----------
ghpython_script_2 = GhPythonScript(Curve=fillet, Direction=area_2.Centroid, Distance=negative)  # -> out, a; same code as ghpython_script
chart_appearance = ChartAppearance(
    ChartToModify=create_chart,
    Colors=[ColourSwatch(SwatchColor=RGB(78, 117, 255)), ColourSwatch(SwatchColor=RGB(14, 243, 0)), ColourSwatch(SwatchColor=RGB(228, 82, 0))])

# ---- group: CONCRETE PROFILE
number_slider = Slider(10, range=0..10)
offset_curve = OffsetCurve(Curve=ghpython_script.a, Distance=value_listener_6.Values, Plane=PlaneXY(0, 0, 0), Corners=1)
unit_y_2 = UnitY(Factor=number_slider)
loft = Loft(
    Curves=flatten([offset_curve, ghpython_script.a]),
    Options={Adjust=False, Closed=False, LoftEnds=0, LoftSimp=0, LoftType=0, Rebuild=10, Refit=0.01})
create_material_2 = CreateMaterial(Diffuse=RGB(244, 255, 215), Specular=RGB(255, 255, 255), Emission=RGB(0, 4, 0), Transparency=0, Shine=1)
extrude_2 = Extrude(Base=loft, Direction=unit_y_2)
area_3 = Area(Geometry=loft)  # -> Area, Centroid
custom_preview_2 = CustomPreview(Geometry=extrude_2, Material=create_material_2)
multiplication = Multiplication(A=area_3.Area, B=number_slider)

# ---- group: Cost of Total bolts
division = Division(A=number_slider, B=value_listener_15.Values)
round = Round(Number=division)  # -> Nearest, Floor, Ceiling
to_get_number_of_bolts = Panel("1")
subtraction = Subtraction(A=value_listener_11.Values, B=to_get_number_of_bolts)
multiplication_2 = Multiplication(A=round.Ceiling, B=subtraction)
multiplication_3 = Multiplication(A=multiplication_2, B=value_listener_4.Values)

# ----
panel_6 = Panel(multiplication_3)
multiplication_4 = Multiplication(A=multiplication, B=value_listener_3.Values)
addition_2 = Addition(A=multiplication_4, B=multiplication_3)
data_recorder = DataRecorder(addition_2, DataLimit=3, RecordData=True)

# ---- group: BOLT Spacing
number_slider_2 = Slider(0, range=0..1)
divide_curve = DivideCurve(Curve=offset_curve, Count=value_listener_11.Values, Kinks=False)  # -> Points, Tangents, Parameters
replace_items = ReplaceItems(List=divide_curve.Points, Indices=[number_slider_2, value_listener_11.Values], Wrap=False)
divide_curve_2 = DivideCurve(Curve=ghpython_script_2.a, Count=value_listener_11.Values, Kinks=False)  # -> Points, Tangents, Parameters
replace_items_2 = ReplaceItems(List=divide_curve_2.Points, Indices=[number_slider_2, value_listener_11.Values], Wrap=False)
line_4 = Line(StartPoint=replace_items_2, EndPoint=replace_items)
unit_y_3 = UnitY(Factor=value_listener_15.Values)
division_2 = Division(A=number_slider, B=value_listener_15.Values)
linear_array = LinearArray(Geometry=line_4, Direction=unit_y_3, Count=division_2)  # -> Geometry, Transform
unit_y_4 = UnitY(Factor=Slider(0.5, range=0..1))
move_3 = Move(Geometry=linear_array.Geometry, Motion=unit_y_4)  # -> Geometry, Transform
colour_swatch = ColourSwatch(SwatchColor=RGB(27, 21, 148))
curve = Curve(move_3.Geometry)
pipe = Pipe(Curve=curve, Radius=Slider(0.093, range=0..1), Caps=0)
custom_preview_3 = CustomPreview(Geometry=flatten(pipe), Material=colour_swatch)

# ----
set_chart_contents = SetChartContents(ChartToModify=create_chart, NewChartValues=data_recorder, NewChartNames=panel_5)
adjust_element_appearance = AdjustElementAppearance(ElementsToAdjust=create_chart, FontSize=15)
move_4 = Move(Geometry=join_curves, Motion=unit_y)  # -> Geometry, Transform
end_points = EndPoints(Curve=move_4.Geometry)  # -> Start, End
end_points_2 = EndPoints(Curve=join_curves)  # -> Start, End
_4point_surface = _4PointSurface(CornerA=end_points.Start, CornerB=end_points.End, CornerC=end_points_2.End, CornerD=end_points_2.Start)
volume_of_concrete_in_m3 = Panel(multiplication)
colour_swatch_2 = ColourSwatch(SwatchColor=RGB(255, 255, 255))
colour_swatch_3 = ColourSwatch(SwatchColor=RGB(10, 230, 0))
divide_surface = DivideSurface(Surface=_4point_surface, UCount=Slider(1, range=0..100), VCount=10)  # -> Points, Normals, Parameters
number_slider_3 = Slider(400, range=0..1000)
mesh = Mesh(<mesh referenced from the Rhino model>)
c_script = CSharpScript(counter=3)  # -> out, A; inputs counter: Int32, listLength: list of Int32
# ---------- c_script: C# ----------
    List<int> FinalList = new List<int>();

    //Print(x.ToString());

    for( int i = 0;i <= 3;i++) // to create N number of list
    { //Print(i.ToString());
      // Print(listLength[i].ToString());

      for(int j = 1;j <= listLength[i];j++) // to fill list with zero,ones to seperate the geometry
      { FinalList.Add(i); //Print(j.ToString());
        //Print(listLength[i - 1].ToString());
        //Print(listLength.Count.ToString());
      }
      } A = FinalList;
# ---------- end c_script ----------
create_3d_view = Create3DView(
    MeshToDisplay=flatten(mesh),
    MeshColors=[colour_swatch_2, colour_swatch_3, colour_swatch],
    ViewWidth=number_slider_3,
    ViewHeight=number_slider_3)
merge_2 = Merge(Data1=extrude, Data2=extrude_2, Data3=pipe)  # -> flatten(Result)
geometry = Geometry(flatten(merge_2))
list_length = ListLength(List=geometry)
data_recorder_limit_3 = DataRecorder(list_length, DataLimit=4, RecordData=True)
# HARD coded counter value as 3 for three samples
c_script_2 = CSharpScript(counter=3, listLength=data_recorder_limit_3)  # -> out, A; inputs counter: Int32, listLength: list of Int32; same code as c_script
panel_7 = Panel(c_script_2.out)
set_3d_view = Set3DView(_3DView=create_3d_view, MeshToDisplay=geometry, MeshColors=[colour_swatch_2, colour_swatch_3, colour_swatch])
set_3d_view_properties = Set3DViewProperties(_3DView=create_3d_view, ShowViewCube=True, AllowPan=True, AllowZoom=True, AllowMove=True, PerspectiveParallel=True)
panel_8 = Panel(c_script_2.A)
panel_9 = Panel(data_recorder_limit_3)
create_label = CreateLabel(LabelText="Current Design View", LabelSize=24, Justification=1)
create_stack_2 = CreateStack(UIElements=[create_3d_view, create_label], Horizontal=False)
# NEEDS to be refresh before start of software
data_recorder_2 = DataRecorder(geometry, DataLimit=-96, RecordData=True)
create_3d_view_2 = Create3DView(
    MeshToDisplay=flatten(mesh),
    MeshColors=[colour_swatch_2, colour_swatch_3, colour_swatch],
    ViewWidth=number_slider_3,
    ViewHeight=number_slider_3)
sift_pattern = SiftPattern(List=data_recorder_2, SiftPattern=panel_8)  # -> Output0, Output1, Output2, Output3
panel_10 = Panel(sift_pattern.Output1)
panel_11 = Panel(data_recorder_2)
clean_tree = CleanTree(RemoveNulls=True, RemoveInvalid=True, RemoveEmpty=False, Tree=sift_pattern.Output1)
clean_tree_2 = CleanTree(RemoveNulls=True, RemoveInvalid=True, RemoveEmpty=False, Tree=sift_pattern.Output0)  # disabled
clean_tree_3 = CleanTree(RemoveNulls=True, RemoveInvalid=True, RemoveEmpty=False, Tree=sift_pattern.Output2)
clean_tree_4 = CleanTree(RemoveNulls=True, RemoveInvalid=True, RemoveEmpty=False, Tree=sift_pattern.Output3)
# The first group is not connected as it is default design option
panel_12 = Panel(clean_tree_2)
create_label_2 = CreateLabel(LabelText="Use Drop down list to view previous design options", LabelSize=24, Justification=1)
create_stack_3 = CreateStack(UIElements=[create_3d_view_2, create_label_2], Horizontal=False)
geometry_2 = Geometry(clean_tree_2)  # disabled
geometry_3 = Geometry(clean_tree)
geometry_4 = Geometry(clean_tree_3)
geometry_5 = Geometry(clean_tree_4)
set_3d_view_properties_2 = Set3DViewProperties(
    _3DView=create_3d_view_2,
    ShowViewCube=True,
    AllowPan=True,
    AllowZoom=True,
    AllowMove=True,
    AllowRotation=True,
    PerspectiveParallel=True)
panel_13 = Panel("""Default
Design Option 1
Design Option 2
Design Option 3""")
create_pulldown_menu = CreatePulldownMenu(Label="Reference Design Options", ListItems=panel_13, SelectedIndex=0, showLabel=True)
create_stack_4 = CreateStack(UIElements=[create_stack_3, create_pulldown_menu], Horizontal=False)
merge_3 = Merge(
    Data1=create_expander,
    Data2=create_chart,
    Data3=create_stack_2,
    Data4=create_stack,
    Data5=create_stack_4,
    Data6=create_pulldown_menu,
    Data7=create_image)
create_grid = CreateGrid(
    UIElements=merge_3,
    Width=get_screen_dimensions.Width,
    Height=get_screen_dimensions.Height,
    RowDefinitions=[Slider(650, range=0..1000), Slider(350, range=0..1000), Slider(699, range=0..1000)],
    ColumnDefinitions=[Slider(550, range=0..1000), Slider(687, range=0..1000), Slider(670, range=0..1000)],
    ElementRow=panel,
    ElementColumn=panel_2,
    ElementRowSpan=1,
    ElementColumnSpan=1)
add_elements = AddElements(Window=launch_window, Elements=flatten(create_grid), DoVLChecking=True)  # -> AddedElements, ElementNames
adjust_element_appearance_2 = AdjustElementAppearance(ElementsToAdjust=create_pulldown_menu, FontSize=20)
value_listener_17 = ValueListener(Elements=create_pulldown_menu, SomeProperty=True)  # -> Values, Indices
c_script_3 = CSharpScript(x=value_listener_17.Indices, OPT01=geometry_3, OPT02=geometry_4, OPT03=geometry_5)  # -> out, A; inputs x: Int32, OPzero: GeometryBase, OPT01: GeometryBase, OPT02: GeometryBase, OPT03: GeometryBase
# ---------- c_script_3: C# ----------
       /* for(int i = 1;i <= x;i++)
    {

      if(i == x){ A = OPT01; Print(x.ToString());}
    else if(i == x){ A = OPT02;}
    else if(i == x){ A = OPT03;}
    }
*/
    switch(x)
      {case 1:
        A = OPT01;Print(x.ToString());
        break;

      case 2:
        A = OPT02;Print(x.ToString());
        break;

      case 3:
        A = OPT03;Print(x.ToString());
        break;

    }
# ---------- end c_script_3 ----------
set_3d_view_2 = Set3DView(
    _3DView=create_3d_view_2,
    MeshToDisplay=c_script_3.A,
    MeshColors=[ColourSwatch(SwatchColor=RGB(0, 255, 255)), ColourSwatch(SwatchColor=RGB(253, 0, 0)), colour_swatch])
panel_14 = Panel(value_listener_17.Indices)
panel_15 = Panel(c_script_3.out)
panel_16 = Panel(c_script_3.A)
